# Grasshopper definition testSample.gh (Grasshopper 1.0.7)
# plug-ins: pluginForGrasshopper

number_slider = Slider(90, range=0..100)
construct_point = ConstructPoint(XCoordinate=0, YCoordinate=0, ZCoordinate=0)
colum = Colum(Size=Slider(1, range=0..1), Diameter=Slider(62, range=0..100), Height=Slider(462, range=0..1000), Point=construct_point)  # -> Geometry, Point
number_slider_2 = Slider(6, range=0..10)
lutou = LuTou(Size=number_slider_2, Point=colum.Point)  # -> Geometry, Point
huakung = HuaKung(Size=number_slider_2, Point=lutou.Point)  # -> Geometry, PointMid, PointOut, PointIns
nitaokung = NiTaoKung(Size=number_slider_2, Point=lutou.Point)  # -> Geometry, PointMid, PointOut, PointIns
chiaohutou = ChiaoHuTou(Size=number_slider_2, Point=[huakung.PointOut, huakung.PointIns])  # -> Geometry, Point
mankung = ManKung(Size=number_slider_2, Point=nitaokung.PointMid)  # -> Geometry, PointMid, PointOut, PointIns
kuatzukung = KuaTzuKung(Size=number_slider_2, Point=chiaohutou.Point)  # -> Geometry, PointMid, PointOut, PointIns
shanlutou = ShanLuTou(Size=number_slider_2, Point=flatten([kuatzukung.PointOut, kuatzukung.PointIns, mankung.PointOut, mankung.PointIns]))  # -> Geometry, Point
